# Grasshopper definition algorithm.gh (Grasshopper 1.0.4)

# ---- group: input
pd = Slider(68, range=65..70)
width = Slider(136, range=130..140)
lens = Geometry(<curve referenced from the Rhino model>)

# ---- group: center lens
connect = ConnectCurves(Curves=lens, Continuity=2, Close=True, Bulge=1)
closed_lens = Geometry(connect)
area = Area(Geometry=closed_lens)  # -> Area, Centroid
centerpoint = Point(area.Centroid)
pdecon = Deconstruct(Point=centerpoint)  # -> XComponent, YComponent, ZComponent
number = Number(-1)
number_2 = Number(-1)
multiplication = Multiplication(A=pdecon.YComponent, B=number)
multiplication_2 = Multiplication(A=number_2, B=pdecon.XComponent)
X = UnitX(Factor=multiplication_2)
Y = UnitY(Factor=multiplication)
move = Move(Geometry=lens, Motion=X)  # -> Geometry, Transform
move_2 = Move(Geometry=move.Geometry, Motion=Y)  # -> Geometry, Transform
centered_lens = Geometry(move_2.Geometry)

# ---- group: create groove
highest_point = Point(Point(0, 70, 0))
crv_cp = CurveClosestPoint(Point=highest_point, Curve=centered_lens)  # -> Point, Parameter, Distance
lens_groove_point_1 = Geometry(crv_cp.Point)
number_3 = Number(1)
number_4 = Number(-1)
Z = UnitZ(Factor=number_3)
Z_2 = UnitZ(Factor=number_4)
move_3 = Move(Geometry=lens_groove_point_1, Motion=Z_2)  # -> Geometry, Transform
move_4 = Move(Geometry=lens_groove_point_1, Motion=Z)  # -> Geometry, Transform
number_5 = Number(-1)
number_6 = Number(-1)
Y_2 = UnitY(Factor=number_6)
Y_3 = UnitY(Factor=number_5)
move_5 = Move(Geometry=move_4.Geometry, Motion=Y_2)  # -> Geometry, Transform
move_6 = Move(Geometry=move_3.Geometry, Motion=Y_3)  # -> Geometry, Transform
lens_groove_point_2 = Geometry(move_6.Geometry)
lens_groove_point_3 = Geometry(move_5.Geometry)
polyline = PolyLine(Vertices=[lens_groove_point_2, lens_groove_point_1, lens_groove_point_3], Closed=False)
Y_4 = UnitY(Factor=1)
move_7 = Move(Geometry=polyline, Motion=Y_4)  # -> Geometry, Transform
highest_point_2 = Point(Point(0, 0, 23))
lowest_point = Point(Point(0, 0, -20))
groove_line_for_lens = Geometry(move_7.Geometry)
ln = Line(StartPoint=highest_point_2, EndPoint=lowest_point)
railrev = RailRevolution(Curve=groove_line_for_lens, Rail=centered_lens, Axis=ln, Scale=False)
groove_surface = Geometry(railrev)

# ---- group: width
division = Division(A=width, B=2)
division_2 = Division(A=width, B=2)
_50 = Number(50)
_0 = Number(0)
division_3 = Division(A=width, B=-2)
_50_2 = Number(-50)
_0_2 = Number(0)
division_4 = Division(A=width, B=-2)
_50_3 = Number(50)
_0_3 = Number(0)
_50_4 = Number(-50)
_0_4 = Number(0)
pt = ConstructPoint(XCoordinate=division, YCoordinate=_50, ZCoordinate=_0)
pt_2 = ConstructPoint(XCoordinate=division_2, YCoordinate=_50_2, ZCoordinate=_0_2)
pt_3 = ConstructPoint(XCoordinate=division_3, YCoordinate=_50_3, ZCoordinate=_0_3)
pt_4 = ConstructPoint(XCoordinate=division_4, YCoordinate=_50_4, ZCoordinate=_0_4)
ln_2 = Line(StartPoint=pt, EndPoint=pt_2)
ln_3 = Line(StartPoint=pt_3, EndPoint=pt_4)

# ---- group: mirror
_2 = Number(2)
division_5 = Division(A=pd, B=_2)
X_2 = UnitX(Factor=division_5)
move_8 = Move(Geometry=groove_surface, Motion=X_2)  # -> Geometry, Transform
mirror = Mirror(Geometry=move_8.Geometry, Plane=PlaneYZ(0, 0, 0))  # -> Geometry, Transform
right_lens = Geometry(move_8.Geometry)
left_lens = Geometry(mirror.Geometry)
